# Grasshopper definition 4450_HW04_npod.gh (Grasshopper 1.0.8)
# plug-ins: jSwan, Karamba3D, Capture, Sampler

node_x_position = Slider(18.75, range=0..20)
node_z_position = Slider(18.76, range=0.1..20)

radius = Slider(10, range=0..10)
number_of_legs = Slider(9, range=5..15)

# ---- group: npod generator
pt = Point(Point(0, 0, 0))
circle = CircleCNR(Center=pt, Normal=Vector(0, 0, 1), Radius=radius)
vec = VectorXYZ(XComponent=node_x_position, YComponent=0, ZComponent=node_z_position)  # -> Vector, Length

# ----
sampler = Sampler(
    Variables=[node_x_position, node_z_position],
    Samples=Slider(50, range=0..100),
    Type=1,
    Seed=Slider(0, range=0..100),
    Directory="None")  # -> DesignMap, Data
panel = Panel(vec.Vector)
panel_2 = Panel(sampler.DesignMap)

# ---- group: npod generator / free node
move = Move(Geometry=pt, Motion=vec.Vector)  # -> Geometry, Transform

# ---- group: npod generator / evenly spaced points around a circle
divide = DivideCurve(Curve=circle, Count=number_of_legs, Kinks=False)  # -> Points, Tangents, Parameters

# ---- group: npod generator / create legs of truss
ln = Line(StartPoint=divide.Points, EndPoint=move.Geometry)

# ---- group: karamba analysis
vec_2 = VectorXYZ(XComponent="-2", YComponent=0, ZComponent="-5")  # -> Vector, Length
linetobeam = LineToBeamKaramba3D(
    Line=ln,
    New=True,
    Remove=True,
    LimitDistance_m=0.005,
    Bending=Toggle(False),
    SetBucklingLength=True,
    ToPolylineMaxAngle=0.03,
    ToPolylineTolerance=0.01,
    ToPolylineMaxEdgeLength=0.25)  # -> Element, Points, Info
supp = SupportKaramba3D(PosInd=divide.Points, menu=[buttons(on, on, on, off, off, off)])
loads = LoadsKaramba3D(ForceVector=vec_2.Vector, Local=False, PosInd=move.Geometry, LCase="0", mode="Point")
assemble = AssembleModelKaramba3D(Elem=linetobeam.Element, Support=supp, Load=loads, LimitDistance_m=0.005)  # -> Model, Info, Mass_kg, CenterOfGravity, LoadCaseNames
analyze = AnalyzeKaramba3D(Model=assemble.Model)  # -> CalculatedModel, MaximumDisplacement_cm, ResultingForceOfGravity_kN, ElasticEnergyChange_kNm
beamview = BeamViewKaramba3D(Model=analyze.CalculatedModel)  # -> Model, MeshesOfRenderedBeams, DeformedBeamAxes, LegendColors, LegendTags

# ---- group: performance measure
b_forces = BeamForcesKaramba3D(AnalyzedModel=analyze.CalculatedModel, Ts="0")  # -> AnalyzedModel, flatten(NormalForce_kN), ShearForceVz_kN, ShearForceVy_kN, TorsionalMomentMt_kNm, BendingMomentMy_kNm, BendingMomentMz_kNm
abs = Absolute(Value=b_forces.NormalForce_kN)
len = Length(Curve=ln)
multiplication = Multiplication(A=abs, B=len)
ma = MassAddition(Input=multiplication)  # -> Result, PartialResults

# ---- group: sum of F*L
panel_3 = Panel(ma.Result)

# ----
capture = Capture(
    Variables=[node_x_position, node_z_position],
    Objectives=panel_3,
    Mode=3,
    Properties=0,
    DesignMap=sampler.DesignMap,
    CsvDirectory="None",
    ScreenshotDirectory="None",
    BackupFrequency=0)  # -> DesignMapObjectives, CapturedProperties, Data, Images, Index
num = Number(capture.DesignMapObjectives)
item = ListItem(List=num, Index=0, Wrap=True)  # -> flatten(Item)
item_2 = ListItem(List=num, Index=Slider(1, range=0..1), Wrap=True)  # -> flatten(Item)
item_3 = ListItem(List=num, Index=Slider(2, range=0..10), Wrap=True)  # -> flatten(Item)
rejson = SerializeJson(X=item, Z=item_2, Data3=item_3, IncludeNullAndEmptyProperties=False)
panel_4 = Panel(rejson)
